# Grasshopper definition vCol exporter.gh (Grasshopper 0.9.76)
# Copyright: Co-de-iT
# plug-ins: Weaverbird
# STL import, color and color tabe output for Processing

# <WS NAME>
# <subtitle>
# tutor: <tutor name | es. Alessio Erioli>
# <place> . <date>
dir_type = ValueList({"desktop": 0, "documents": 1, "GH file path": 2, "C:": 3}, selected="GH file path")
custom_subdir = Panel("data")
file_name_extension = Panel("spheres_fused.stl")
file_name_extension_2 = Panel("spheres_united.stl")
file_name_extension_3 = Panel("optMesh.stl")
mesh = ValueList({"from file": 0, "from Rhino": 1}, selected="from Rhino")
mesh_2 = Mesh(<mesh referenced from the Rhino model>)
# Save mesh Vertex color to File
# 
# Exports a vertex color text file. Automatically reads your user directory and finds its way to Desktop. Doc folder, sketch folder or C drive.
# 
# code by Alessio Erioli
# 
# v 1.0
# 
# © Co-de-iT 2016 _ Creative Commons Attribution-NonCommercial-ShareAlike 4.0 International License
dir = CSharpScript(type=dir_type, dir=custom_subdir)  # -> out, A; inputs type: Int32, dir: String
# ---------- dir: C# ----------
    String S = "";
    String root = "";
    String end = "\\";
    switch(type){
      case 0:
        root = Environment.GetFolderPath(Environment.SpecialFolder.Desktop);
        S = "Desktop";
        break;
      case 1:
        root = Environment.GetFolderPath(Environment.SpecialFolder.MyDocuments);
        S = "Documents";
        break;
      case 2:
        GH_Document gh_d = owner.OnPingDocument();

        if (gh_d.IsFilePathDefined)
        {
          //root = gh_d.FilePath; // this includes the filename, which we don't want
          root = (System.IO.Path.GetDirectoryName(GrasshopperDocument.FilePath));
          S = "GH File path";
        }
        else
        {
          Print("No path defined. Saving to Desktop until then");
          root = Environment.GetFolderPath(Environment.SpecialFolder.Desktop);
          S = "path?(Desktop)";
        }
        break;
      case 3:
        root = "C:";
        S = root + end;
        break;
    }
    A = root + end + (dir != null ? (dir + end) : "");
    Component.Message = S;
# ---------- end dir ----------
wbjoin = WeaverbirdsJoinMeshesAndWeld(Mesh=mesh_2, Weld=Toggle(True))
txt = Text(file_name_extension)
concat = Concatenate(FragmentA=dir.A, FragmentB=txt)
rad = Radians(Degrees="180")
# NOTE: at the moment welding here de-syncs vertex and color order in Processing
# 
# - bug to be fixed
c_script = CSharpScript(F=concat, wA=rad)  # -> out, Mesh; inputs F: String, wA: Double
# ---------- c_script: C# ----------
                                /*
    original VB.net code by Ola Jaensson
    found on http://www.grasshopper3d.com/forum/topics/import-an-stl-file-direct-in-grasshopper

    C# adaptation by Alessio Erioli - Co-de-iT 2017

    */

    Component.Message = "STL importer";
    Component.Params.Input[0].Description = "the input file path";
    Component.Params.Input[1].Description = "weld Angle";

    if (wA == 0) wA = Math.PI;

    byte[] stl = System.IO.File.ReadAllBytes(F);
    Print("File length: " + stl.Length + " bytes");
    long numtris = BitConverter.ToInt32(stl, 80);
    Print("Number of triangles: " + numtris);
    int c = 0;
    int pos = 0;
    Mesh tempmesh = new Mesh();
    Vector3f tempvect = default(Vector3f);
    if (numtris * 50 + 84 == stl.Length) {
      Print("STL file length matches the number of triangle faces");
      for (c = 0; c <= numtris - 1; c++) {
        pos = c * 50 + 84;
        tempvect = readVect3f(ref stl, ref pos);
        Mesh _with1 = tempmesh;
        _with1.Vertices.SetVertex(c * 3, readPoint3f(ref stl, ref pos));
        _with1.Vertices.SetVertex(c * 3 + 1, readPoint3f(ref stl, ref pos));
        _with1.Vertices.SetVertex(c * 3 + 2, readPoint3f(ref stl, ref pos));
        _with1.Faces.SetFace(c, c * 3, c * 3 + 1, c * 3 + 2);
        _with1.Normals.SetNormal(c * 3, tempvect);
        _with1.Normals.SetNormal(c * 3 + 1, tempvect);
        _with1.Normals.SetNormal(c * 3 + 2, tempvect);
      }
      tempmesh.Weld(wA);
    } else {
      Print("STL file length does not match the number of triangle faces");
    }
    Mesh = tempmesh;
# ---------- c_script: C# additional code ----------
  private float readSingle(ref byte[] stl, ref int pos)
  {
    float functionReturnValue = 0;
    functionReturnValue = BitConverter.ToSingle(stl, pos);
    pos = pos + 4;
    return functionReturnValue;
  }

  private Vector3f readVect3f(ref byte[] stl, ref int pos)
  {
    return new Vector3f(readSingle(ref stl, ref pos), readSingle(ref stl, ref pos), readSingle(ref stl, ref pos));
  }

  private Point3f readPoint3f(ref byte[] stl, ref int pos)
  {
    return new Point3f(readSingle(ref stl, ref pos), readSingle(ref stl, ref pos), readSingle(ref stl, ref pos));
  }
# ---------- end c_script ----------
split = TextSplit(Text=txt, Separators=".")
filter = StreamFilter(Gate=mesh, Stream0=c_script.Mesh, Stream1=wbjoin)
item = ListItem(List=split, Index=0, Wrap=True)
mesh_3 = Mesh(filter)
pt = Point([Point(-33.63227085, 0.07089077787, -1.399957994), Point(-0.3564452026, -13.28122862, 0), Point(0.8207885032, 1.84067972, 15.99694377), Point(-1.069737162, 22.42240325, 1.032362402), Point(1.419416373, -0.1547815318, -18.77745361)])
concat_2 = Concatenate(FragmentA=item, FragmentB="_vCols.txt")
merge = Merge(
    Data1=ColourSwatch(SwatchColor=RGB(255, 191, 0)),
    Data2=ColourSwatch(SwatchColor=RGB(255, 255, 255)),
    Data3=ColourSwatch(SwatchColor=RGB(41, 163, 161)),
    Data4=ColourSwatch(SwatchColor=RGB(0, 0, 0)),
    Data5=ColourSwatch(SwatchColor=RGB(240, 0, 0)))
destination_directory = Panel(dir.A)
output_file_name_extension = Panel(concat_2)
concat_3 = Concatenate(FragmentA=dir.A, FragmentB=concat_2)
mspray = MeshSpray(Mesh=mesh_3, Points=pt, Colours=merge, SprayMode=11)
demesh = DeconstructMesh(Mesh=mesh_3)  # -> Vertices, Faces, Colours, Normals
frequency = Slider(0.45, range=0..1)
demesh_2 = DeconstructMesh(Mesh=mspray)  # -> Vertices, Faces, Colours, Normals
color_by_distance = ColorByDistance(points=demesh.Vertices, attractors=pt, frequency=frequency)
# put to false in case
# of unwelded mesh
just_color = BooleanToggle(True)
conmesh = ConstructMesh(Vertices=demesh.Vertices, Faces=demesh.Faces, Colours=color_by_distance)
save = Button()
txtexp = CSharpScript(P=demesh_2.Vertices, C=color_by_distance, justCol=just_color, F=concat_3, w=save)  # -> out, A; inputs P: list of Point3d, C: list of Int32, justCol: Boolean, F: String, w: Boolean
# ---------- txtexp: C# ----------
                                        /*
    .txt exporter
    (c) Co-de-iT 2016
    */
    String eol = Environment.NewLine;
    Component.Message = "vCol exporter" + eol + "v 1.0 by Co-de-iT";

    String s = "", sep = "_";
    List<String> vertices = new List <String>();
    if (justCol){
      for (int k = 0; k < P.Count; k++){
        s = "";
        s += C[k].ToString();
        vertices.Add(s);
      }
    }else{
      for (int k = 0; k < P.Count; k++){
        s = "";
        s += P[k].X.ToString() + "," + P[k].Y.ToString() + "," + P[k].Z.ToString();
        s += sep + C[k].ToString();
        vertices.Add(s);
      }
   }

    if (w) System.IO.File.WriteAllLines(F, vertices);

    A = vertices;
# ---------- end txtexp ----------
exported_data = Panel(txtexp.A)

# ==== cluster ColorByDistance
points = ClusterInput()
frequency = ClusterInput()
attractors = ClusterInput()
dist = Distance(PointA=graft(points), PointB=attractors)
sort = SortList(Keys=dist)  # -> Keys, ValuesA
item = ListItem(List=sort.Keys, Index=0, Wrap=True)
multiplication = Multiplication(A=item, B=frequency)
sin = Sine(Value=multiplication)  # -> flatten(Result)
bnd = Bounds(Numbers=flatten(sin))
remap = RemapNumbers(Value=sin, Source=bnd, Target=Domain(0, 1))  # -> Mapped, Clipped
gradient = Gradient(LowerLimit=0, UpperLimit=1, Parameter=remap.Mapped, stops=[0.0345: RGB(137, 205, 240), 0.98: RGB(14, 26, 76)])
color_data = ClusterOutput(gradient)
