# Grasshopper definition Curves r-w_connect.gh (Grasshopper 0.9.76)
# Copyright: Co-de-iT

# Curves R/W
# read curves/connect
# code: Alessio Erioli
# v 05 Feb 2017
# drag and drop Curves_02.txt file here
# and connect it to the data component
file = ReadFile(
    File="F:\Users\alessio\Documents\Processing\sketches\P5 thesis 2017\@ extra\curves\GH_curves i-o\Curves_02.txt",
    PerLineParse=True)
# > read
data = Data(file)
# imports curves from file and generates structural-kind connections
panel = Panel(data)
split = TextSplit(Text=data, Separators="_")
pt = Point(split)
pline = PolyLine(Vertices=pt, Closed=False)

divlength = DivideLength(Curve=pline, Length=Slider(21.1, range=10..50))  # -> Points, Tangents, Parameters
pline_2 = PolyLine(Vertices=divlength.Points, Closed=False)  # -> reparameterize(Polyline)

# ----
# reduce polyline - adaptive sampling
# reduce polyline - uniform sampling
number_slider = Slider(0.95, range=0..1)
redpline = Reduce(Polyline=pline, Tolerance=number_slider)  # -> reparameterize(Polyline), Reduction

re_sampling = ValueList({"Adaptive": 0, "Uniform": 1}, selected="Adaptive")
# NOTE
# 
# never mind orange or red components
# they are meant to generate errors in some cases
panel_2 = Panel(split)
filter = StreamFilter(Gate=re_sampling, Stream0=redpline.Polyline, Stream1=pline_2)

explode = Explode(Curve=filter, Recursive=True)  # -> Segments, Vertices
# another way to do it
end = EndPoints(Curve=explode.Segments)  # -> Start, End
merge = Merge(Data1=graft(end.Start), Data2=graft(end.End))

disc = Discontinuity(Curve=filter, Level=1)  # -> Points, Parameters
bishift = DoubleShift(list=disc.Points, wrap=False)  # -> no_last, no_first
merge_2 = Merge(Data1=graft(bishift.no_last), Data2=graft(bishift.no_first))

preview = CustomPreview(Geometry=filter, Shader=ColourSwatch(SwatchColor=RGB(47, 89, 84)))
panel_3 = Panel("points in pairs")
bishift_2 = DoubleShift(list=disc.Parameters, wrap=False)  # -> no_last, no_first
merge_3 = Merge(Data1=graft(bishift_2.no_last), Data2=graft(bishift_2.no_first))

direction_angle = Panel("0.5")
range_of_vision = Panel("0.25")
avr = Average(Input=merge_2)
cps = ClosestPoints(Point=avr, Cloud=flatten(disc.Points), Count="3")  # -> ClosestPoint, CPIndex, Distance
pi = Pi(Factor=range_of_vision)
pi_2 = Pi(Factor=direction_angle)
# finds closest point to every pair of points in a direction and angle range
vec2pt = Vector2Pt(PointA=avr, PointB=graft(bishift.no_first), Unitize=False)  # -> Vector, Length
vec2pt_2 = Vector2Pt(PointA=avr, PointB=cps.ClosestPoint, Unitize=False)  # -> Vector, Length
subtraction = Subtraction(A=pi_2, B=pi)
addition = Addition(A=pi_2, B=pi)
angle = Angle(VectorA=vec2pt.Vector, VectorB=vec2pt_2.Vector)  # -> Angle, Reflex
larger = LargerThan(FirstNumber=angle.Angle, SecondNumber=subtraction)  # -> LargerThan, OrEqualTo
smaller = SmallerThan(FirstNumber=angle.Angle, SecondNumber=addition)  # -> SmallerThan, OrEqualTo
and = GateAnd(A=larger.LargerThan, B=smaller.SmallerThan)
dispatch = Dispatch(List=cps.ClosestPoint, DispatchPattern=and)  # -> ListA, ListB

# ----
# points
# parameters t
pt_2 = Point(simplify(merge_2))
num = Number(simplify(merge_3))
item = ListItem(List=dispatch.ListA, Index=0, Wrap=True)  # -> simplify(Item)
item_2 = ListItem(List=pt_2, Index=0, Wrap=True)  # -> Item, Item1
merge_4 = Merge(Data1=item_2.Item, Data2=item, Data3=item_2.Item1)
clean = CleanTree(RemoveNulls=True, RemoveInvalid=True, RemoveEmpty=False, Tree=merge_4)
lng = ListLength(List=clean)
equals = Equality(FirstNumber=lng, SecondNumber="3")  # -> Equality, Inequality
dispatch_2 = Dispatch(List=clean, DispatchPattern=equals.Equality)  # -> ListA, ListB
dispatch_3 = Dispatch(List=num, DispatchPattern=equals.Equality)  # -> ListA, ListB

panel_4 = Panel("filters null results")

item_3 = ListItem(List=dispatch_2.ListA, Index=0, Wrap=True)  # -> Item, Item1, Item2
opening_curve = Slider(0.267, range=0.001..1)
vec2pt_3 = Vector2Pt(PointA=item_3.Item, PointB=item_3.Item2, Unitize=False)  # -> Vector, Length
multiplication = Multiplication(A=vec2pt_3.Vector, B=opening_curve)
rev = Reverse(Vector=multiplication)
move = Move(Geometry=item_3.Item2, Motion=multiplication)  # -> Geometry, Transform
move_2 = Move(Geometry=item_3.Item, Motion=rev)  # -> Geometry, Transform
merge_5 = Merge(Data1=move_2.Geometry, Data2=dispatch_2.ListA, Data3=move.Geometry)
pline_3 = PolyLine(Vertices=dispatch_2.ListA, Closed=False)
intcrv = Interpolate(Vertices=merge_5, Degree=3, Periodic=False, KnotStyle=1)  # -> Curve, Length, Domain

panel_5 = Panel("builds curves")
curve_type = ValueList({"polylines": 0, "curves": 1, "fillet tangent polylines": 2}, selected="fillet tangent polylines")
crv = Curve(pline_3)
crv_2 = Curve(intcrv.Curve)

opening = Slider(0.7, range=0.001..1)
damper = Slider(0.01, range=0..0.1)
item_4 = ListItem(List=dispatch_3.ListA, Index=0, Wrap=True)  # -> Item, Item1
multiplication_2 = Multiplication(A=opening, B=damper)
subtraction_2 = Subtraction(A=item_4.Item, B=multiplication_2)
# this part uses the curve parameter information of each point to "slide" them apart along their curve, thus preserving tangency of the outer elements
addition_2 = Addition(A=item_4.Item1, B=multiplication_2)
merge_6 = Merge(Data1=subtraction_2, Data2=addition_2)
crv_3 = Curve(simplify(filter))

clean_2 = CleanTree(RemoveNulls=True, RemoveInvalid=True, RemoveEmpty=False, Tree=merge_6)
lng_2 = ListLength(List=clean_2)
equals_2 = Equality(FirstNumber=lng_2, SecondNumber="2")  # -> Equality, Inequality

dispatch_4 = Dispatch(List=merge_6, DispatchPattern=equals_2.Equality)  # -> ListA, ListB
pshift = ShiftPaths(Data=dispatch_4.ListA, Offset=-1)
eval = EvaluateCurve(Curve=crv_3, Parameter=pshift)  # -> Point, Tangent, Angle
unflatten = UnflattenTree(Tree=eval.Point, Guide=dispatch_3.ListA)
item_5 = ListItem(List=unflatten, Index=0, Wrap=True)  # -> Item, Item1
merge_7 = Merge(Data1=item_5.Item, Data2=dispatch_2.ListA, Data3=item_5.Item1)
pline_4 = PolyLine(Vertices=merge_7, Closed=False)
fillet = Fillet(Curve=pline_4, Radius=Slider(1.48, range=0..5))

filter_2 = StreamFilter(Gate=curve_type, Stream0=crv, Stream1=crv_2, Stream2=fillet)
preview_2 = CustomPreview(Geometry=filter_2, Shader=ColourSwatch(SwatchColor=RGB(85, 173, 163)))

# ==== cluster DoubleShift: Shifts a list +1 and -1, wrap option available
list = ClusterInput()
wrap = ClusterInput()
shift = ShiftList(List=list, Shift=1, Wrap=wrap)
shift_2 = ShiftList(List=list, Shift="-1", Wrap=wrap)
no_last = ClusterOutput(shift_2)
no_first = ClusterOutput(shift)
