# Grasshopper definition Curves r-w_text file.gh (Grasshopper 0.9.76)
# Copyright: Co-de-iT

file_name_extension = Panel("curves.txt")
dir_type = ValueList({"desktop": 0, "documents": 1, "GH file path": 2, "C:": 3}, selected="GH file path")
custom_subdir = Panel("data")
# v 10 Jan 2017
# the curves you want to export
crv = Curve([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])
# Curves R/W
# read-write curves
# code: Alessio Erioli
# drag and drop the .txt file here
# and connect it to the data component
# > read
data = Data()
dirg = DirectoryGenerator(type=dir_type, subDir=custom_subdir)  # -> dir; inputs type: Int32, subDir: String
# ---------- dirg: C# ----------
                    /*
    Path Generator

    code by Alessio Erioli - value list generation based on code by James Ramsden

    (c) Co-de-iT 2017
    */

    String S = "";
    String root = "";
    String end = "\\";
    String eol = Environment.NewLine;
    // variable for the list
    Grasshopper.Kernel.Special.GH_ValueList vList;

    Component.Name = "directory generator";
    Component.NickName = "dirG";
    Component.Description = "generates a path based on local direcories such as Desktop, Documents, GH file path";
    Component.Params.Input[0].Name = "dir type";
    Component.Params.Input[0].Description = "directory type: 0 desktop, 1 documents, 2 GH file path, 3 C:" + eol + "connect a value list for automatic list generation";
    Component.Params.Input[1].Name = "custom subdir";
    Component.Params.Input[1].Description = "(optional) custom subdirectory";


    // tries to cast input as list
    try{

      // if the list is not the first parameter then change Input[0] to the corresponding value
      vList = (Grasshopper.Kernel.Special.GH_ValueList) Component.Params.Input[0].Sources[0];
      // Print("value list connected");
      // check if the list must be created
      //if (vList.NickName != "dir type"){
      if (!vList.NickName.Equals("dir type")){
        vList.ClearData();
        vList.ListItems.Clear();
        vList.NickName = "dir type";
        var item1 = new Grasshopper.Kernel.Special.GH_ValueListItem("desktop", "0");
        var item2 = new Grasshopper.Kernel.Special.GH_ValueListItem("documents", "1");
        var item3 = new Grasshopper.Kernel.Special.GH_ValueListItem("GH file path", "2");
        var item4 = new Grasshopper.Kernel.Special.GH_ValueListItem("C:", "3");
        vList.ListItems.Add(item1);
        vList.ListItems.Add(item2);
        vList.ListItems.Add(item3);
        vList.ListItems.Add(item4);

        vList.ListItems[0].Value.CastTo(out type);
      }
    }
    catch{
      // handles anything that is not a value list

    }


    switch(type){
      case 0:
        root = Environment.GetFolderPath(Environment.SpecialFolder.Desktop);
        S = "Desktop";
        break;
      case 1:
        root = Environment.GetFolderPath(Environment.SpecialFolder.MyDocuments);
        S = "Documents";
        break;
      case 2:
        GH_Document gh_d = owner.OnPingDocument();

        if (gh_d.IsFilePathDefined)
        {
          root = gh_d.FilePath;
          S = "GH File path";
        }
        else
        {
          Print("No path defined. Saving to Desktop until then");
          root = Environment.GetFolderPath(Environment.SpecialFolder.Desktop);
          S = "Desktop";
        }
        break;
      case 3:
        root = "C:";
        S = root + end;
        break;
    }
    dir = root + end + (subDir != null ? (subDir + end) : "");
    Component.Message = S;
# ---------- end dirg ----------
separator = Panel("_")
export = Button()
concat = Concatenate(FragmentA=dirg, FragmentB=file_name_extension)
panel = Panel(data)
divide = DivideCurve(Curve=crv, Count=Slider(38, range=2..100), Kinks=False)  # -> Points, Tangents, Parameters
preview = CustomPreview(Geometry=crv, Shader=ColourSwatch(SwatchColor=RGB(255, 255, 255)))
split = TextSplit(Text=data, Separators=separator)
# > write
txtexp = CSharpScript(P=divide.Points, F=concat, sep=separator, w=export)  # -> out, A; inputs P: tree of Point3d, F: String, sep: String, w: Boolean
# ---------- txtexp: C# ----------
    /*
    .txt exporter
    (c) Co-de-iT 2016
    */
    String eol = Environment.NewLine;
    Component.Message = "txt exporter" + eol + "v 1.0 by Co-de-iT";

    String s = "";
    List<String> curves = new List <String>();
    for (int k = 0; k < P.BranchCount; k++){
      s = "";
      for (int i = 0; i < P.Branches[k].Count; i++){
        s += P.Branches[k][i].X.ToString() + "," + P.Branches[k][i].Y.ToString() + "," +
          P.Branches[k][i].Z.ToString();
        if (i < P.Branches[k].Count - 1) s += sep;
      }
      curves.Add(s);
    }

    if (w) System.IO.File.WriteAllLines(F, curves);

    A = curves;
# ---------- end txtexp ----------
pt = Point(split)
pline = PolyLine(Vertices=pt, Closed=False)
panel_2 = Panel(txtexp.A)
panel_3 = Panel(split)
preview_2 = CustomPreview(Geometry=pt, Shader=ColourSwatch(SwatchColor=RGB(0, 130, 115)))
preview_3 = CustomPreview(Geometry=pline, Shader=ColourSwatch(SwatchColor=RGB(85, 173, 163)))
