# Grasshopper definition export pts-vecs.gh (Grasshopper 0.9.76)
# Copyright: Co-de-iT
# plug-ins: Human

crv = Curve(reparameterize(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))
curve_s = ValueList({"curve(to poly)": 0, "single polyline": 1, "multiple polylines": 2}, selected="multiple polylines")
crv_2 = Curve(reparameterize([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]))
crv_3 = Curve(reparameterize(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))
divide = DivideCurve(Curve=crv, Count=Slider(71, range=10..100), Kinks=False)  # -> Points, Tangents, Parameters
brep = Brep(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)
pline = PolyLine(Vertices=divide.Points, Closed=False)

# ---- group: voxelize geometry
voxelize_geometry = VoxelizeGeometry(geometry=brep, n_cells=Slider(17, range=0..20))  # -> points, voxel_size

# ----
pop3d = Populate3D(Region=brep, Count=Slider(1500, range=10..2000), Seed=1)
filter = StreamFilter(Gate=curve_s, Stream0=pline, Stream1=crv_3, Stream2=crv_2)
num = Number(voxelize_geometry.voxel_size)
crv_4 = Curve(filter)
box = CenterBox(Base=PlaneXY(0, 0, 0), X=num, Y=num, Z=num)
pt = Point(voxelize_geometry.points)
n_directions = Panel("4")
smesh = SimpleMesh(Brep=box)

# ---- group: field direction
field_direction = FieldDirection(points=pt, polylines=crv_4)  # -> vectors, planes

# ----
previewlw = CustomPreviewLineweights(Geometry=crv_4, Shader=ColourSwatch(SwatchColor=RGB(255, 255, 255)), Thickness="3", Absolute=False)
vector_field = ValueList({"continuous": 0, "discrete": 1}, selected="continuous")
move = Move(Geometry=smesh, Motion=voxelize_geometry.points)  # -> Geometry, Transform

# ---- group: disctretize vectors
discretize_vectors = DiscretizeVectors(vectors=field_direction.vectors, n_of_directions=n_directions)  # -> discretized_vectors, discretized_vector_grouped_by_direction

# ----
prox = Proximity3D(Points=pt, Group=5)  # -> Links, Topology
filter_2 = StreamFilter(Gate=vector_field, Stream0=field_direction.vectors, Stream1=discretize_vectors.discretized_vectors)
bnd = Bounds(Numbers=flatten(prox.Links))
vec = Vector(filter_2)
# on the points
pt_2 = Point(pt)

number_slider = Slider(12.153, range=1..20)
# approximated direction
line = LineSDL(Start=pt_2, Direction=discretize_vectors.discretized_vectors, Length=number_slider)
# field direction
line_2 = LineSDL(Start=pt_2, Direction=field_direction.vectors, Length=number_slider)

multiplication = Multiplication(A=Slider(10, range=1..100), B=vec)
move_2 = Move(Geometry=pt, Motion=multiplication)  # -> Geometry, Transform
unit = UnitVector(Vector=vec)
panel = Panel(bnd)
vdisex = VectorDisplayEx(Point=pt, Vector=multiplication, Colour=unit, Width=2)
vdisex_2 = VectorDisplayEx(Point=pt, Vector=multiplication, Colour=RGB(0, 0, 0), Width=2)
expression = Expression(P=vec, Expression="Format(\"{0},{1},{2}\",P.x,P.y,P.z)")
expression_2 = Expression(P=pt, Expression="Format(\"{0},{1},{2}\",P.x,P.y,P.z)")
panel_2 = Panel(expression)
panel_3 = Panel(expression_2)

item = ListItem(List=line, Index=discretize_vectors.discretized_vector_grouped_by_direction, Wrap=True)
bang = ExplodeTree(Data=item)  # -> Branch0, Branch1, Branch2, Branch3, Branch4
# group by direction
swatch = ColourSwatch(SwatchColor=RGB(255, 0, 0))
preview = CustomPreview(Geometry=bang.Branch0, Shader=swatch)
preview_2 = CustomPreview(Geometry=bang.Branch1, Shader=ColourSwatch(SwatchColor=RGB(255, 255, 255)))
preview_3 = CustomPreview(Geometry=bang.Branch2, Shader=ColourSwatch(SwatchColor=RGB(0, 64, 255)))
preview_4 = CustomPreview(Geometry=bang.Branch3, Shader=ColourSwatch(SwatchColor=RGB(25, 255, 0)))

dir_type = ValueList({"desktop": 0, "documents": 1, "GH file path": 2, "C:": 3}, selected="GH file path")
custom_subdir = Panel("data")
dir = CSharpScript(type=dir_type, dir=custom_subdir)  # -> out, A; inputs type: Int32, dir: String
# ---------- dir: C# ----------
    String S = "";
    String root = "";
    String end = "\\";
    switch(type){
      case 0:
        root = Environment.GetFolderPath(Environment.SpecialFolder.Desktop);
        S = "Desktop";
        break;
      case 1:
        root = Environment.GetFolderPath(Environment.SpecialFolder.MyDocuments);
        S = "Documents";
        break;
      case 2:
        GH_Document gh_d = owner.OnPingDocument();

        if (gh_d.IsFilePathDefined)
        {          
          //root = gh_d.FilePath; // this includes the filename, which we don't want
          root = (System.IO.Path.GetDirectoryName(GrasshopperDocument.FilePath));
          S = "GH File path";
        }
        else
        {
          Print("No path defined. Saving to Desktop until then");
          root = Environment.GetFolderPath(Environment.SpecialFolder.Desktop);
          S = "Desktop";
        }
        break;
      case 3:
        root = "C:";
        S = root + end;
        break;
    }
    A = root + end + (dir != null ? (dir + end) : "");
    Component.Message = S;
# ---------- end dir ----------
destination_directory = Panel(dir.A)

txt = Text(flatten(panel_2))
txt_2 = Text(flatten(panel_3))
save = Button()
file_name_extension = Panel("vectors.txt")
file_name_extension_2 = Panel("points.txt")
savetofile = SaveToFile(S=txt, dir=dir.A, file=file_name_extension, save=save)  # -> out; inputs S: list of String, dir: String, file: String, save: Boolean
# ---------- savetofile: C# ----------
    String eol = Environment.NewLine;
    Component.Message = "write to file";
    Component.Name = "Save to File";
    Component.NickName = "SaveToFile";
    Component.Description = "Saves a text sequence to a file";

    if (save){
      if (!Directory.Exists(dir)) Directory.CreateDirectory(dir);

      String target = dir + file;

        System.IO.File.WriteAllLines(target, S.ToArray());
        Print("file saved as: " + target);
    } else {
      Print("press save button to save pdl file");
    }
# ---------- end savetofile ----------
savetofile_2 = SaveToFile(S=txt_2, dir=dir.A, file=file_name_extension_2, save=save)  # -> out; inputs S: list of String, dir: String, file: String, save: Boolean; same code as savetofile

# ==== cluster DiscretizeVectors
n_of_directions = ClusterInput()
vectors = ClusterInput()
X = UnitX(Factor=1)
vangsign = VectorAngleWithSign(V1=vectors, V2=X)  # -> out, A; inputs V1: Vector3d, V2: Vector3d
# ---------- vangsign: C# ----------
    Component.Name = "Vector Angle with sign";
    Component.NickName = "VAngSign";
    Component.Description = "Computes angle with sign between vectors \n \n v 0.1 (c) Co-de-iT";
    Component.Message = "Angle with Sign \n v 0.1 (c) Co-de-iT";

    V1.Unitize();
    V2.Unitize();
    A = System.Math.Atan2(V2.Y, V2.X) - System.Math.Atan2(V1.Y, V1.X);
# ---------- end vangsign ----------
pi = Pi(Factor="0.25")
subtraction = Subtraction(A=vangsign.A, B=pi)
pi_2 = Pi(Factor="-2")
remap = RemapNumbers(Value=subtraction, Source="-PI to PI", Target=Domain(0, 1))  # -> Mapped, Clipped
Y = UnitY(Factor=1)
range = Range(Domain=pi_2, Steps=n_of_directions)
Z = UnitZ(Factor=1)
multiplication = Multiplication(A=remap.Clipped, B=n_of_directions)
vrot = Rotate(Vector=Y, Axis=Z, Angle=range)
expression = Expression(x=multiplication, Expression="floor(x)")
cull_i = CullIndex(List=vrot, Indices="-1", Wrap=True)
item = ListItem(List=cull_i, Index=graft(expression), Wrap=True)  # -> flatten(Item)

# ----
# group by direction
cset = CreateSet(List=expression)  # -> Set, Map
mindex = MemberIndex(Set=expression, Member=cset.Set)  # -> Index, Count

discretized_vectors = ClusterOutput(item)
discretized_vector_grouped_by_direction = ClusterOutput(mindex.Index)

# ==== cluster FieldDirection
points = ClusterInput()
polylines = ClusterInput()
crv = Curve(reparameterize(flatten(polylines)))
explode = Explode(Curve=crv, Recursive=True)  # -> reparameterize(Segments), Vertices
pt = Point(flatten(points))
vec = Vector(explode.Segments)
bishift = DoubleShift(list=vec, wrap="False")  # -> graft(no_last), graft(no_first)
xprod = CrossProduct(VectorA=bishift.no_first, VectorB=bishift.no_last, Unitize=False)  # -> Vector, Length
pshift = ShiftPaths(Data=xprod.Vector, Offset=-1)
item = ListItem(List=pshift, Index=0, Wrap=True)  # -> Item1, Item
lng = ListLength(List=flatten(explode.Segments))
merge = Merge(Data1=item.Item, Data2=pshift, Data3=item.Item1)
series = Series(Start=0, Step=1, Count=lng)
crv_cp = CurveClosestPoint(Point=graft(pt), Curve=flatten(explode.Segments))  # -> Point, Parameter, Distance
bishift_2 = DoubleShift(list=merge, wrap="False")  # -> graft(no_last), graft(no_first)
int = Integer(series)
merge_2 = Merge(Data1=bishift_2.no_last, Data2=bishift_2.no_first)
sort = SortList(Keys=crv_cp.Distance, ValuesA=crv_cp.Parameter, ValuesB=int, ValuesC=crv_cp.Point)  # -> Keys, ValuesA, ValuesB, ValuesC
group = Group(Objects=merge_2)  # -> flatten(Group)
item_2 = ListItem(List=sort.ValuesC, Index=0, Wrap=True)  # -> flatten(Item)
item_3 = ListItem(List=sort.ValuesA, Index=0, Wrap=True)
item_4 = ListItem(List=sort.ValuesB, Index=0, Wrap=True)
item_5 = ListItem(List=group, Index=item_4, Wrap=True)
vec2pt = Vector2Pt(PointA=pt, PointB=item_2, Unitize=False)  # -> Vector, Length
ungroup = Ungroup(Group=item_5)
interp = InterpolateData(Data=ungroup, Parameter=item_3, Interpolation=2)  # -> flatten(Value)
pl = ConstructPlane(Origin=pt, XAxis=vec2pt.Vector, YAxis=interp)
xprod_2 = CrossProduct(VectorA=vec2pt.Vector, VectorB=interp, Unitize=True)  # -> Vector, Length
vectors = ClusterOutput(xprod_2.Vector)
planes = ClusterOutput(pl)

# ==== cluster VoxelizeGeometry
geometry = ClusterInput()
n_cells = ClusterInput()
bbox = BoundingBox(Content=geometry, Plane=PlaneXY(0, 0, 0), UnionBox=True)  # -> Box, Box_2
debrep = DeconstructBrep(Brep=bbox.Box)  # -> Faces, Edges, Vertices
panel = Panel("""0
3
8""")
item = ListItem(List=debrep.Vertices, Index=0, Wrap=True)
item_2 = ListItem(List=debrep.Edges, Index=panel, Wrap=True)
sort = SortList(Keys=item_2)  # -> reverse(Keys), ValuesA
item_3 = ListItem(List=sort.Keys, Index=0, Wrap=True)
division = Division(A=item_3, B=n_cells)
recgrid = Rectangular(Plane=item, SizeX=division, SizeY=division, ExtentX=n_cells, ExtentY=n_cells)  # -> Cells, graft(Points)
series = Series(Start=0, Step=division, Count=n_cells)
multiplication = Multiplication(A=division, B="0.5")
Z = UnitZ(Factor=series)
move = Move(Geometry=recgrid.Points, Motion=Z)  # -> Geometry, Transform
vec = VectorXYZ(XComponent=multiplication, YComponent=multiplication, ZComponent=multiplication)  # -> Vector, Length
move_2 = Move(Geometry=move.Geometry, Motion=vec.Vector)  # -> Geometry, Transform
ln = Line(StartPoint=move.Geometry, EndPoint=move_2.Geometry)
minc = MeshInclusion(Mesh=geometry, Point=move_2.Geometry, Strict=False)
dispatch = Dispatch(List=move_2.Geometry, DispatchPattern=minc)  # -> ListA, ListB
clean = CleanTree(RemoveNulls=True, RemoveInvalid=True, RemoveEmpty=False, Tree=flatten(dispatch.ListA))
points = ClusterOutput(clean)
voxel_size = ClusterOutput(multiplication)

# ==== cluster DoubleShift: Shifts a list +1 and -1, wrap option available
list = ClusterInput()
wrap = ClusterInput()
shift = ShiftList(List=list, Shift=1, Wrap=wrap)
shift_2 = ShiftList(List=list, Shift="-1", Wrap=wrap)
no_last = ClusterOutput(shift_2)
no_first = ClusterOutput(shift)
