# Grasshopper definition import curves_iso.gh (Grasshopper 0.9.76)
# Copyright: Co-de-iT
# plug-ins: MarchingCubes, Human, Mesh Pipe

file = ReadFile(
    File="F:\Users\alessio\Documents\Processing\sketches\P5 thesis 2017\@ extra\import_pts_vectors\export_data\0028lines.txt",
    PerLineParse=True)
split = TextSplit(Text=file, Separators="_")
pt = Point(split)
pline = PolyLine(Vertices=pt, Closed=False)  # -> flatten(Polyline)
join = JoinCurves(Curves=pline, Preserve=False)
mpipe = MeshPipe(Curve=join, Radius=Slider(1, range=0.01..1), Accuracy=0.2, Rotation=0, Segments="3", Caps=2)
curve_charge = CurveCharge(Curve=join, Radius=Slider(2, range=0..3), ChargeStrengths=Slider(1, range=0..1))
cocoon = Cocoon(Charges=curve_charge, Iso=Slider(0.15, range=0..1), CellSize=Slider(2, range=1..20), Execute=Toggle(False), Simple=False)  # -> Mesh, RefinementData
refine = Refine(
    RefinementData=cocoon.RefinementData,
    Samples=Slider(3, range=1..10),
    SampleSize=Slider(0.25, range=0..1),
    SampleTolerance=Slider(0.25, range=0..1),
    LaplacianSmoothing=Slider(1, range=1..5),
    ValencePasses=Slider(1, range=1..10),
    SubD=Slider(1, range=1..3),
    Execute=Toggle(False))
mjoin = MeshJoin(Meshes=refine)
previewmat = CustomPreviewMaterials(Geometry=mjoin, DiffuseColor=RGB(255, 255, 255))
