# Grasshopper definition Curves r-w_text file.gh (Grasshopper 0.9.76)
# Copyright: Co-de-iT

dir_type = ValueList({"desktop": 0, "documents": 1, "GH file path": 2, "C:": 3}, selected="GH file path")
custom_subdir = Panel("data")
file_name_extension = Panel("curves.txt")
dir = CSharpScript(type=dir_type, dir=custom_subdir)  # -> out, A; inputs type: Int32, dir: String
# ---------- dir: C# ----------
    String S = "";
    String root = "";
    String end = "\\";
    switch(type){
      case 0:
        root = Environment.GetFolderPath(Environment.SpecialFolder.Desktop);
        S = "Desktop";
        break;
      case 1:
        root = Environment.GetFolderPath(Environment.SpecialFolder.MyDocuments);
        S = "Documents";
        break;
      case 2:
        GH_Document gh_d = owner.OnPingDocument();

        if (gh_d.IsFilePathDefined)
        {          
          //root = gh_d.FilePath; // this includes the filename, which we don't want
          root = (System.IO.Path.GetDirectoryName(GrasshopperDocument.FilePath));
          S = "GH File path";
        }
        else
        {
          Print("No path defined. Saving to Desktop until then");
          root = Environment.GetFolderPath(Environment.SpecialFolder.Desktop);
          S = "Desktop";
        }
        break;
      case 3:
        root = "C:";
        S = root + end;
        break;
    }
    A = root + end + (dir != null ? (dir + end) : "");
    Component.Message = S;
# ---------- end dir ----------
# Curves R/W
# read-write curves
# code: Alessio Erioli
# v 10 Jan 2017
# > read
# to choose your own file
# right click on F parameter
# then 'Set One File Path'
# and locate your .txt file
file = ReadFile(
    File="F:\Users\alessio\Documents\Processing\sketches\P5 thesis 2017\@ WIP\@ curves\GH_curves i-o\Curves r-w_text.txt",
    PerLineParse=True)
crv = Curve([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])
preview = CustomPreview(Geometry=crv, Shader=ColourSwatch(SwatchColor=RGB(255, 255, 255)))
panel = Panel(file)
export = Button()
divide = DivideCurve(Curve=crv, Count=Slider(38, range=2..100), Kinks=False)  # -> Points, Tangents, Parameters
concat = Concatenate(FragmentA=dir.A, FragmentB=file_name_extension)
split = TextSplit(Text=file, Separators="_")
pt = Point(split)
# > write
txtexp = CSharpScript(P=divide.Points, F=concat, sep="_", w=export)  # -> out, A; inputs P: tree of Point3d, F: String, sep: String, w: Boolean
# ---------- txtexp: C# ----------
    /*
    .txt exporter
    (c) Co-de-iT 2016
    */
    String eol = Environment.NewLine;
    Component.Message = "txt exporter" + eol + "v 1.0 by Co-de-iT";

    String s = "";
    List<String> curves = new List <String>();
    for (int k = 0; k < P.BranchCount; k++){
      s = "";
      for (int i = 0; i < P.Branches[k].Count; i++){
        s += P.Branches[k][i].X.ToString() + "," + P.Branches[k][i].Y.ToString() + "," +
          P.Branches[k][i].Z.ToString();
        if (i < P.Branches[k].Count - 1) s += sep;
      }
      curves.Add(s);
    }

    if (w) System.IO.File.WriteAllLines(F, curves);

    A = curves;
# ---------- end txtexp ----------
pline = PolyLine(Vertices=pt, Closed=False)
panel_2 = Panel(split)
panel_3 = Panel(txtexp.A)
preview_2 = CustomPreview(Geometry=pt, Shader=ColourSwatch(SwatchColor=RGB(0, 130, 115)))
preview_3 = CustomPreview(Geometry=pline, Shader=ColourSwatch(SwatchColor=RGB(85, 173, 163)))
